# Grasshopper definition Speckle Grasshopper - Documentation.gh (Grasshopper 1.0.8)
# plug-ins: Speckle.Connector.Grasshopper

# ---- group: Objects - 1 : Speckle Geometry
# Use the `Speckle Geometry` passthrough node to create or mutate Speckle Geometry.
# 
# 1. Add an optional Speckle Geometry if you want to inspect or mutate an existing geometry.
# 2. Add an optional `Geometry` input. Will mutate the input Speckle Geometry, or create a new Geometry.
# 3. Add an optional `Name` input. Will mutate the Speckle Geometry.
# 4. Add an optional `Properties` input. Speckle Properties and User Content are accepted.
# 5. Add an optional `Color` input. Shows in Shaded mode when viewing your model online.
# 6. Add an optional `Material` input. Shows in Rendered mode when viewing your model online.
# 7. Click `⊕` to add an optional `Application ID` input and output.
# 
# Rhino Model Objects are also accepted on the Speckle Geometry input.
# Every output reflects the result, so this node also works for inspecting existing geometry.
colour_swatch = ColourSwatch(SwatchColor=RGB(255, 255, 255))
# OBJECTS
# See the `Speckle Geometry Param` for more information on behavior in Grasshopper.
speckle_object = SpeckleObject()
geometry = Geometry()
speckle_properties = SpeckleProperties()
speckle_material = SpeckleMaterial()
speckle_geometry = SpeckleGeometry(
    SpeckleGeometry=speckle_object,
    Geometry=geometry,
    Properties=speckle_properties,
    Color=colour_swatch,
    Material=speckle_material,
    HasApplicationIdParam=False)  # -> SpeckleGeometry, Geometry, Name, Properties, Color, Material, Path

# ---- group: Collections - 1 : Collection Selector
# COLLECTIONS
# Speckle Collections are containers for Speckle Objects. All Speckle Models are structured by Collections, which can represent Layers, Categories, Levels, etc in the source application.
# Speckle Models are Collections themselves. See the `Speckle Collection param` for more information on behavior in Grasshopper.
# Use the Collection Selector input node to view all of the sub-Collection paths inside the input Collection.
# 
# Add the required input Collection parameter. This can be the output of the Load nodes.
# You will see all the Collections inside your input Collection by their path (similar to Rhino Layers)
# Left-click to select a Collection path, or shift+left-click to select multiple.
# Double click the Search field at the top to filter paths that match the search. Supports regex.
# 
# This node is used as an optional input for the Query Objects node
speckle_collection = SpeckleCollection()
collection_selector = CollectionSelector(speckle_collection, AutoSelectAllItems=False)

# ---- group: Parameters - 1 : Speckle Collection
# PARAMETERS
# These parameters represent Speckle entities, and are interoperable with native Rhino and Grasshopper entities. Some also contain bake capabilities.
# Speckle Collection Param represents Layers in the Rhino context.
# 
# CASTING:
# - Castable to and from Grasshopper 8 Model Layers.
#   Preserves Name, Color, and Material.
# 
# BAKE:
# - Will create a Layer in the Rhino Document.
#   Uses the full path, Name, Color, and Material of the Collection.
# 
# PREVIEW:
# - Will preview all contained Objects inside the Collection.
speckle_collection_2 = SpeckleCollection()

# ---- group: Dev - 1 : Deconstruct
# DEV
# Dev components give you additional features, for advanced Speckle and Grasshopper users.
# Use the `Deconstruct` node to inspect all fields inside a Speckle Param.
# 
# 1. Add a Speckle Object, Speckle Material, Speckle Properties, or Speckle Collection input.
# 2. An output will be generated for every field of the Speckle param.
# 
# This component exposes fields on any Base-derived Speckle entity that isn't convertible to native Rhino/GH.
speckle_collection_3 = SpeckleCollection()
speckle_data_object = SpeckleDataObject()
speckle_material_2 = SpeckleMaterial()
speckle_properties_2 = SpeckleProperties()
speckle_geometry_2 = SpeckleGeometry()
deconstruct = Deconstruct(SpeckleParam=[speckle_collection_3, speckle_data_object, speckle_geometry_2, speckle_material_2, speckle_properties_2])

# ---- group: Operations - 1 : Speckle Model Link
# Speckle for Grasshopper
# Welcome to the Speckle Next-Gen Grasshopper connector!
# Use this sample file for documentation on each Speckle node.
# 
# Full Speckle Grasshopper documentation is available at:
# 
# docs.speckle.systems/connectors/grasshopper/grasshopper
# 
# Speckle for Grasshopper and docs is built and maintained by bjorn@speckle.systems.
# Reach out on speckle.community for feedback, bug reports, and requests.
# Documentation
# OPERATIONS
# Speckle operations allow you to publish your Grasshopper model to Speckle, or load any model into Grasshopper.
# https://app.speckle.systems/projects/8be1007be1/models/13a2953168
# Use the `Speckle Model` input node for all of your account, workspace, and model management.
# 
# 1. Right click node to change Account
# 2. Left click first button to change workspace
# 3. Left click `Select Project` button to select your project
# 3. Left click `Select Model` button to select your model
# 4. By default, the version will be the latest version. Left click node `Version` to select a specific version.
# 
# Alternatively, pipe in a text url copied from your model on the Speckle web app.
# The Project, Model, and Version information will be populated for you automatically.
speckle_model = SpeckleModel(Server="https://next.speckle.dev", User="F59D3E3267614EE8E8B6421D8EB51012")

# ---- group: Parameters - 2 : Speckle Geometry
# Speckle Geometry Param represents geometries in the Rhino context.
# 
# CASTING:
# - Castable to and from Grasshopper 8 Model Objects.
#   Preserves Name, User Strings, Color, and Material.
# - Castable to and from Geometry
# 
# BAKE:
# - Will create a Geometry object in the Rhino Document in its Layer.
#   Bakes with Name, User Strings, Color, and Material.
#   Layers for the Collection path will be created if they do not exist.
#   Material for the geometry will be created if it does not exist.
# 
# PREVIEW:
# - Will preview any geometry contained in the Speckle Geometry.
speckle_geometry_3 = SpeckleGeometry()

# ---- group: Dev - 2 : (Sync) Load
# Use the `(Sync) Load` node to load your Speckle model into Grasshopper.
# 
# 1. Add the required Model input from the `Speckle Model` node
# 2. Connect a boolean toggle and set to `True`
# 3. Your Speckle model will now load synchronously. Larger models will take longer to load.
# 4. Your loaded model is a Speckle Collection object, previewed by this node.
# 5. The `Properties` output contains any model-wide properties saved with the version.
# 
# *This node will run synchronously.*
# As soon as you toggle `Run` to `True`, your Grasshopper script will freeze until the load is complete.
# Use this node if you are running in an environment that does not support async operations.
boolean_toggle = BooleanToggle(False)
sync_load = SyncLoad(Run=boolean_toggle)  # -> Collection, Properties

# ---- group: Objects - 2 : Filter Objects
# Use the `Filter Objects` node to filter Speckle Objects that match search requirements.
# 
# 1. Add the list of Objects to filter.
# 2. Add an optional `Name` input. Only objects with matching names will remain.
# 3. Add an optional `Property Key` input. Only objects with a matching property key will remain.
# 4. Add an optional `Property Value` input. Only objects with a matching property value will remain.
# 5. Add an optional `Material Name` input. Only objects with matching materials will remain.
# 6. Click `⊕` to add an optional `Application Id` input. Only matching applicationIds will remain.
# 7. Click `⊕` to add an optional `Speckle Id` input. Only objects with matching id will remain.
# 
# Mouseover the input parameters to see match options: Equals (default), StartsWith(<),
# EndsWith(>), Contains(?) and Regex(;).
# All objects that don't match the filter requirements will be output in Culled Objects
speckle_object_2 = SpeckleObject()
filter_objects = FilterObjects()  # -> Objects, CulledObjects

# ---- group: Collections - 2 : Expand Collection
# Use the Expand Collection node to get the direct children of the input Collection.
# Direct children can be either other Collections, or Speckle Objects.
# 
# Add the required input Collection parameter. This can be the output of the Load nodes.
# An output parameter will be generated for every sub-collection inside the input Collection.
# Speckle Objects directly inside the input Collection are output in a single _objects parameter.
# Right-click an output and select extract parameter to create a param node with that output's value
# and name.
# 
# Collections built from a data tree come back out as the same tree, so this is also how you restore
# branch structure after loading.
# 
# This node can be chained consecutively to retrieve the direct children of any output Collections.
# This is an alternative to the "Collection Selector + Query Objects" nodes.
speckle_collection_4 = SpeckleCollection()
expand_collection = ExpandCollection(Collection=speckle_collection_4)

# ---- group: Operations - 2 : Load
# Use the `Load` node to load your Speckle model into Grasshopper.
# 
# 1. Add the required Model input from the Speckle Model node (Operations - 1)
# 2. Press the `Load` button
# 3. Right-click node and select `Cancel Load` to cancel an ongoing Load operation.
# 4. Your loaded Speckle model is a Speckle Collection object, previewed by this node.
# 5. The `Properties` output contains any model-wide properties saved with the version, such as project
#  information. This is empty when the version has none.
# 
# This node will run async: you can continue to use Grasshopper while your model is loading.
# Right click to enable automatic loading of new versions of your model.
# This option is available as long as you do not specify a specific version to load in your Speckle Model input.
load = Load(AutoReceive=False)  # -> Collection, Properties

# ---- group: Parameters - 3 : Speckle Block Definition
# Speckle Block Definition Param represents block definitions in the Rhino context.
# 
# CASTING:
# - Castable to and from Grasshopper 8 Model block definitions.
# 
# BAKE:
# - Will create a block definition in the Rhino Document with its geometry.
# 
# PREVIEW:
# - Will preview the geometry contained in the definition.
speckle_block_definition = SpeckleBlockDefinition()

# ---- group: Collections - 3 : Create Collection
# Use Create Collection node to create Speckle Collections to structure your Speckle Model.
# 
# This node has variable inputs. Each input will create a sub Collection in the output Collection.
# Right-click any input to change the name of the sub-Collection
# Pipe Speckle Objects, Speckle Geometry, or Speckle Collections into the input. A single input can hold a mix of these.
# Remove any empty collections that you don't want
# 
# Tips: Press TAB while adding an input to inherit the input nickname.
# Or right-click the node and select Always inherit names to turn this setting on for all inputs.
# 
# This node is primarily used to create the Speckle Model for publishing to Speckle.
speckle_object_3 = SpeckleObject()
speckle_collection_5 = SpeckleCollection()
create_collection = CreateCollection(SubCollection1=speckle_collection_5, SubCollection2=speckle_object_3, AlwaysInheritNames=False)

# ---- group: Dev - 3 : (Sync) Publish
# Use the `(Sync) Publish` node to publish your GH model to Speckle.
# 
# 1. Add the required Model input from the `Speckle Model` node
# 2. Add the Speckle model you want to publish
# 3. Add an optional `Version Message` to describe this version
# 4. Add optional `Properties` to save model-wide properties with the version
# 5. Connect a boolean toggle and set to `True`
# 6. Your Speckle model will now publish synchronously. Larger models will take longer to publish
# 7. Right-click `View created model online` to open your published model in your default web browser.
# 
# The `Speckle Model` output contains the model you just published, and `Version ID` the id of
# the created version.
# 
# *This node will run synchronously.*
# As soon as you toggle `Run` to `True`, your GH script will freeze until the publish is complete.
# Use this node if you are running in an environment that does not support async operations.
boolean_toggle_2 = BooleanToggle(False)
speckle_collection_6 = SpeckleCollection()
sync_publish = SyncPublish(Collection=speckle_collection_6, Run=boolean_toggle_2)  # -> SpeckleModel, VersionID

# ---- group: Objects - 3 : Query Objects
# Use the `Query Speckle Objects` node to retrieve Speckle Objects inside the input Collection.
# 
# 1. Add the required input Collection parameter. This can be the output of the Load nodes.
# 2. By default, all contained Speckle Objects are output in a flat list, including those
# in sub Collections.
# 3. If paths are input, the direct Speckle Object children of the path are output in a branch per path.
speckle_collection_7 = SpeckleCollection()
query_speckle_objects = QuerySpeckleObjects(Collection=speckle_collection_7)

# ---- group: Operations - 3 : Publish
# Use the `Publish` node to publish your Grasshopper Speckle model to your Speckle Project.
# 
# 1. Add the required Model input from the `Speckle Model` node (Operations - 1)
# 2. Add the Speckle model Collection
# 3. Add an optional `Version Message` to describe this version
# 4. Add optional `Properties` to save model-wide properties with the version, such as project
# information
# 5. Press the `Publish` button
# 6. Right-click node and select `Cancel Publish` to cancel an ongoing Publish operation.
# 7. Right-click node and select `View created model online` to open your published model in
# your default browser.
# 
# The `Speckle Model` output contains the model you just published, and the `Version ID`
# output contains the id of the created version.
# 
# This node will run async: you can continue to use Grasshopper while your model is publishing
# Right-click to enable automatic publishing whenever this node recomputes.
speckle_collection_8 = SpeckleCollection()
publish = Publish(Collection=speckle_collection_8)  # -> SpeckleModel, VersionID

# ---- group: Parameters - 4 : Speckle Block Instance
# Speckle Block Instance Param represents blocks in the Rhino context.
# 
# CASTING:
# - Castable to and from Grasshopper 8 Model instances.
# 
# BAKE:
# - Will create a block instance in the Rhino Document at its transform.
#   The definition is baked with it, and the instance manages its own attributes.
# 
# PREVIEW:
# - Will preview the definition geometry at the instance transform.
speckle_block_instance = SpeckleBlockInstance()

# ---- group: Objects - 4 : Speckle Properties
# Use the `Speckle Properties` passthrough node to create or modify properties by keyvalues.
# 
# 1. Add the optional input Properties parameter to modify an existing set of properties.
# 2. Add the optional set of keys to use.
# 3. Add the optional set of values to use
# 
# Right-click and change the mode if needed.
# By default, mode is set to `Merge` input keys and values to the input set.
# `Replace` swaps the input set for the input keys and values instead.
speckle_properties_3 = SpeckleProperties()
speckle_properties_4 = SpeckleProperties(Properties=speckle_properties_3, Mode="Merge")  # -> Properties, Keys, Values

# ---- group: Collections - 4 : Create Collection by Name
# Use the Collections by Name node to create Collections from a tree of names,
# instead of adding one input per Collection by hand.
# 
# Add a Names input tree of Collection names.
# Add an Objects input tree of the Speckle Objects to group. Its tree structure must
# match the Names tree exactly — same paths, same number of branches.
# Each branch is grouped into a Collection named by that branch's entry in Names.
# Use :: in a name to nest Collections, for example Structure::Columns creates
# Columns inside Structure.
# The Collection output is a root Collection containing all the named sub-Collections,
# ready to publish.
# 
# If a name branch holds more than one name the first is used, and empty object branches
# are skipped. Both cases warn on the canvas.
# 
# This is the tree-driven alternative to Create Collection: use it when your grouping comes
# from data rather than from wiring, for example names generated by your script or read from a spreadsheet.
panel = Panel("sub-collection 1")
speckle_object_4 = SpeckleObject()
collections_by_name = CollectionsByName(Names=panel, Objects=speckle_object_4)

# ---- group: Operations - 4: Sign In
# Use the `Sign In` node to sign in to your Speckle account.
# 
# 1. Optionally input a `Server Url` — only needed if you are signing in to a self-deployed
# Speckle server. Leave it empty to sign in to app.speckle.systems.
# 2. Click `Sign In`
# 3. Complete steps in your web browser
# 4. The `Accounts` output lists all accounts you are signed into on this computer.
# 5. After you sign in once, your account will be stored on your computer locally.
#    You only need to sign in to the same account once across all your Speckle connectors.
# 
# This node can be deleted from your script after sign-nnnnn
sign_in = SignIn()

# ---- group: Parameters - 5 : Speckle Properties
# Speckle Properties Param represents user strings in the Rhino context.
# 
# CASTING:
# - Castable from Grasshopper 8 Model Objects.
#   Lets you use the User Text node to create Properties with keyvalues.
# - Castable to and from Dictionary<string, object?>
# 
# BAKE:
# - None
# 
# PREVIEW:
# - None
speckle_properties_5 = SpeckleProperties()

# ---- group: Dev - 4 : Speckle Model URL
# Use the `Speckle Model URL with Token` input node to authenticate with a developer token
# instead of a signed-in account.
# 
# 1. Add the input Speckle Url
# 2. Add your Speckle Token
# 
# The token needs profile:read, profile:email, stream:read and workspace:read scopes, plus any
# write scopes your script needs.
speckle_model_url = SpeckleModelURL()

# ---- group: Objects - 5 : Property Selector
# Use the `Property Selector` input node to view all of the properties inside an Object.
# 
# 1. Add the required input Properties parameter.
# 2. You will see all the Property keys inside your input Properties, including nested properties.
# 3. Left-click to select a Property key, or shift+left-click to select multiple.
# 4. Double click the `Search` field at the top to filter keys that match the search. Supports regex.
# 
# Right-click for an `Auto-select all items` option.
# This node is used as an input for the `Query Properties` node
speckle_properties_6 = SpeckleProperties()
property_selector = PropertySelector(speckle_properties_6, AutoSelectAllItems=False)

# ---- group: Parameters - 6 : Speckle Material
# Speckle Material Param represents materials in the Rhino/GH context.
# 
# CASTING:
# - Castable to and from GH8 Model Materials.
# - Castable to and from GH8 Render Materials.
# - Castable to and from Display Materials.
# 
# BAKE:
# - Will create a Material in the Rhino Doc with the name of Speckle Material.
#   The Nickname of the param is used when no name exists.
# 
# PREVIEW:
# - None
speckle_material_3 = SpeckleMaterial()

# ---- group: Objects - 6: Query Properties
# Use the `Query Properties` node to retrieve the values of properties by their keys.
# 
# 1. Add the required input Properties parameter.
# 2. Add the required input Keys parameter, for example from the Property Selector node.
# 3. The `Values` output contains the value for each input key, in key order.
# 
# A key whose value is a list is flattened into individual items in the output.
speckle_properties_7 = SpeckleProperties()
query_properties = QueryProperties(Properties=speckle_properties_7)

# ----
speckle_properties_8 = SpeckleProperties()

# ---- group: Objects - 7: Create Properties
# Use `Create Properties` node to create Speckle Properties to add metadata to your Objects.
# 
# 1. This node has variable inputs. Each input will create a Property in the output Properties.
# 2. Right-click any input to change the key of the property
# 3. Inputs can contain:
# - simple types like strings, bools, numbers, planes, and vectors
# - other speckle properties (will nest)
# - right-click and select `list access` to set the access type to list
# 
# Tips: Press `TAB` while adding an input to inherit the input nickname.
# Or right-click the node and select `Always inherit names` to turn this setting on for all inputs.
# 
# The output of this node is used for the `Speckle Geometry` node, or piped straight into a
# `Create Collection` input alongside your geometry.
number = Number()
text = Text()
boolean = Boolean()
create_properties = CreateProperties(
    Property1=number,
    Property2=text,
    Property3=boolean,
    Property4=speckle_properties_8,
    AlwaysInheritNames=False,
    CreateEmptyProperties=False)

# ---- group: Objects - 8: Explore
# Use the `Explore` node to find out what a Speckle Object is connected to.
# 
# 1. Add the Speckle Object you want to explore. Geometry, Data Objects, Block Instances and
# Collections are all accepted.
# 2. Outputs are created for whatever relationships that object actually has, so the node reshapes
# itself depending on what you plug in.
# 
# A wall might give you its level, the rooms it bounds, its type properties and its sub-elements.
# A block instance gives you its definition and the other placements using it.
# A whole Collection gives you every level and its elevation.
# Structural members from ETABS give you their analysis results.
# 
# Material, colour and Collection path are already on the object when it loads, so Explore does
# not repeat them.
# Explore supports versions published with Speckle 2026.9.0 onwards, loaded with the current
# `Load` node.
explore = Explore()

# ---- group: Objects - 9: Expand Properties
# Use the `Expand Properties` node to expand a set of Speckle Properties into one output per key.
# 
# 1. Add the required input Properties parameter.
# 2. An output is generated for every key in the input Properties, named after that key.
# 3. Nested property groups are expanded too, so you get an output per leaf key.
# 
# The outputs are rebuilt whenever the input Properties change, so plugging in a different object
# reshapes the node.
# This is the quick alternative to "Property Selector + Query Properties" when you want everything.
speckle_properties_9 = SpeckleProperties()
expand_properties = ExpandProperties(Properties=speckle_properties_9)

# ---- group: Objects - 10: Speckle Block Definition
# Use the `Speckle Block Definition` passthrough node to create or modify a Speckle Block Definition.
# 
# 1. Add an optional `Block Definition` input to inspect or modify an existing definition.
# Speckle definitions and Rhino Model definitions are accepted.
# 2. Add an optional `Geometry` input of the geometry to include in the definition. Speckle geometry
# and instances, or Rhino Model objects and instances, are accepted.
# 3. Add an optional `Name` input to set or change the name of the definition.
# 4. Click `⊕` to add an optional `Application ID` input and output.
# 
# Pass in either a Definition or Geometry - the node warns if it gets neither.
# The `Block Definition`, `Geometry` and `Name` outputs all reflect the result.
speckle_block_definition_2 = SpeckleBlockDefinition(HasApplicationIdParam=False)  # -> BlockDefinition, Geometry, Name

# ---- group: Objects - 11: Speckle Block Instance
# Use the `Speckle Block Instance` passthrough node to create or modify a Speckle Block Instance.
# 
# 1. Add an optional `Block Instance` input to inspect or modify an existing instance.
# Speckle instances and Grasshopper instances are accepted.
# 2. Add an optional `Definition` input of the definition to place. Speckle definitions and
# Grasshopper definitions are accepted.
# 3. Add an optional `Transform` input. Transforms and Planes are accepted. Defaults to identity.
# 4. Add an optional `Name` input to set or change the name of the instance.
# 5. Add an optional `Properties` input. Speckle Properties and User Content are accepted.
# 6. Add an optional `Color` input.
# 7. Add an optional `Material` input.
# 8. Click `⊕` to add an optional `Application ID` input and output.
# 
# A Block Instance is a type of Speckle Geometry, so it can go straight into a Collection.
speckle_block_instance_2 = SpeckleBlockInstance(HasApplicationIdParam=False)  # -> BlockInstance, Definition, Transform, Name, Properties, Color, Material
